# Grasshopper definition DataMngmt_BielPitman_FinalAssignment_Draft.gh (Grasshopper 1.0.8)
# plug-ins: RhinoCodePluginGH, ShapeDiverForGrasshopper

# ---- group: CONSTRUCTION COST / HospitalityCost
cost_resort = Slider(23098, range=0..1000000)
cost_hotel = Slider(26770, range=0..1000000)
cost_conference_center = Slider(15660, range=0..1000000)
cost_extended_stay = Slider(20880, range=0..1000000)

# ---- group: CONSTRUCTION COST / ResidentialCost
cost_apartments = Slider(21539, range=0..1000000)
cost_condominiums = Slider(17749, range=0..1000000)
cost_single_family = Slider(17749, range=0..1000000)
cost_student_housing = Slider(17749, range=0..1000000)
cost_senior_living = Slider(27732, range=0..1000000)
cost_co_living = Slider(31060, range=0..1000000)

# ---- group: CONSTRUCTION COST / CommercialCost
cost_mall = Slider(34950, range=0..1000000)
cost_food_beverage = Slider(12283, range=0..1000000)
cost_office = Slider(16020, range=0..1000000)
cost_retail = Slider(20996, range=0..1000000)

# ---- group: CONSTRUCTION COST / IndustrialCost
cost_manufacturing = Slider(10439, range=0..1000000)
cost_storage = Slider(14774, range=0..1000000)
cost_warehouse = Slider(20880, range=0..1000000)
cost_data_center = Slider(10441, range=0..1000000)
cost_flex = Slider(20881, range=0..1000000)

# ---- group: CONSTRUCTION COST / ServiceCost
cost_sports = Slider(18478, range=0..1000000)
cost_healthcare = Slider(15660, range=0..1000000)
cost_education = Slider(15660, range=0..1000000)
cost_entertainment = Slider(5220, range=0..1000000)

# ---- group: CONSTRUCTION COST / TransportationCost
cost_transit = Slider(0, range=0..1000000)
cost_parking = Slider(8293, range=0..1000000)

# ---- group: MARKET VALUE / ResidentialValue
sell_apartments = Slider(96667, range=0..1000000)
sell_single_family = Slider(110044, range=0..1000000)
sell_condominiums = Slider(96020, range=0..1000000)
sell_senior_living = Slider(93159, range=0..1000000)
sell_co_living = Slider(86308, range=0..1000000)
sell_student_housing = Slider(103805, range=0..1000000)

# ---- group: MARKET VALUE / CommercialValue
sell_mall = Slider(58929, range=0..1000000)
sell_office = Slider(62858, range=0..1000000)
sell_food_beverage = Slider(75431, range=0..1000000)
sell_retail = Slider(61827, range=0..1000000)

# ---- group: MARKET VALUE / HospitalityValue
sell_resort = Slider(57531, range=0..1000000)
sell_conference_center = Slider(46695, range=0..1000000)
sell_hotel = Slider(46371, range=0..1000000)
sell_extended_stay = Slider(43518, range=0..1000000)

# ---- group: MARKET VALUE / IndustrialValue
sell_manufacturing = Slider(54396, range=0..1000000)
sell_warehouse = Slider(73275, range=0..1000000)
sell_storage = Slider(61159, range=0..1000000)
sell_flex = Slider(40617, range=0..1000000)
sell_data_center = Slider(54396, range=0..1000000)

# ---- group: MARKET VALUE / ServiceValue
sell_sports = Slider(89493, range=0..1000000)
sell_healthcare = Slider(86205, range=0..1000000)
sell_education = Slider(75430, range=0..1000000)
sell_entertainment = Slider(61063, range=0..1000000)

# ---- group: MARKET VALUE / TransportationValue
sell_transit = Slider(74780, range=0..1000000)
sell_parking = Slider(94287, range=0..1000000)

# ---- group: PROGRAM / Commercial
mall = Slider(0, range=0..100)
office = Slider(5, range=0..100)
food_beverage = Slider(0, range=0..100)
retail = Slider(0, range=0..100)

# ---- group: PROGRAM / Hospitality
resort = Slider(0, range=0..100)
conference_center = Slider(0, range=0..100)
hotel = Slider(20, range=0..100)
extended_stay = Slider(0, range=0..100)

# ---- group: PROGRAM / Industrial
manufacturing = Slider(0, range=0..100)
warehouse = Slider(10, range=0..100)
storage = Slider(0, range=0..100)
flex = Slider(0, range=0..100)
data_center = Slider(0, range=0..100)

# ---- group: PROGRAM / Residential
apartments = Slider(40, range=0..100)
condominiums = Slider(0, range=0..100)
single_family = Slider(0, range=0..100)
senior_living = Slider(0, range=0..100)
student_housing = Slider(0, range=0..100)
co_living = Slider(0, range=0..100)

# ---- group: PROGRAM / Services
sports = Slider(0, range=0..100)
healthcare = Slider(10, range=0..100)
education = Slider(0, range=0..100)
entertainment = Slider(0, range=0..100)

# ---- group: PROGRAM / Transportation
transit = Slider(0, range=0..100)
parking = Slider(15, range=0..100)

# ----
sddp = ShapeDiverDocumentPayload({AbsoluteTolerance=0, AngleTolerance=0, DistanceDisplayPrecision=0, GltfVersion="Gltf2", GrasshopperVersion="1.0.0008", InputGroups="{}", OutputGroups="{}", RelativeTolerance=0, RhinoVersion="8.14.24345.15001", UnitSystem=0, VersionCreated="1.22.0.0", VersionSaved="1.22.0.0"})
condominiums_2 = GetNumber(condominiums, AtLeast=1, AtMost=1, Maximum=1.797693135e+308, Minimum=-1.797693135e+308, TreeAccess=False)
parking_2 = GetNumber(parking, AtLeast=1, AtMost=1, Maximum=1.797693135e+308, Minimum=-1.797693135e+308, TreeAccess=False)
transit_2 = GetNumber(transit, AtLeast=1, AtMost=1, Maximum=1.797693135e+308, Minimum=-1.797693135e+308, TreeAccess=False)
co_living_2 = GetNumber(co_living, AtLeast=1, AtMost=1, Maximum=1.797693135e+308, Minimum=-1.797693135e+308, TreeAccess=False)
student_housing_2 = GetNumber(student_housing, AtLeast=1, AtMost=1, Maximum=1.797693135e+308, Minimum=-1.797693135e+308, TreeAccess=False)
office_2 = GetNumber(office, AtLeast=1, AtMost=1, Maximum=1.797693135e+308, Minimum=-1.797693135e+308, TreeAccess=False)
retail_2 = GetNumber(retail, AtLeast=1, AtMost=1, Maximum=1.797693135e+308, Minimum=-1.797693135e+308, TreeAccess=False)
mall_2 = GetNumber(mall, AtLeast=1, AtMost=1, Maximum=1.797693135e+308, Minimum=-1.797693135e+308, TreeAccess=False)
manufacturing_2 = GetNumber(manufacturing, AtLeast=1, AtMost=1, Maximum=1.797693135e+308, Minimum=-1.797693135e+308, TreeAccess=False)
entertainment_2 = GetNumber(entertainment, AtLeast=1, AtMost=1, Maximum=1.797693135e+308, Minimum=-1.797693135e+308, TreeAccess=False)
apartments_2 = GetNumber(apartments, AtLeast=1, AtMost=1, Maximum=1.797693135e+308, Minimum=-1.797693135e+308, TreeAccess=False)
food_beverage_2 = GetNumber(food_beverage, AtLeast=1, AtMost=1, Maximum=1.797693135e+308, Minimum=-1.797693135e+308, TreeAccess=False)
hotel_2 = GetNumber(hotel, AtLeast=1, AtMost=1, Maximum=1.797693135e+308, Minimum=-1.797693135e+308, TreeAccess=False)
conference_center_2 = GetNumber(conference_center, AtLeast=1, AtMost=1, Maximum=1.797693135e+308, Minimum=-1.797693135e+308, TreeAccess=False)
single_family_2 = GetNumber(single_family, AtLeast=1, AtMost=1, Maximum=1.797693135e+308, Minimum=-1.797693135e+308, TreeAccess=False)
extended_stay_2 = GetNumber(extended_stay, AtLeast=1, AtMost=1, Maximum=1.797693135e+308, Minimum=-1.797693135e+308, TreeAccess=False)
resort_2 = GetNumber(resort, AtLeast=1, AtMost=1, Maximum=1.797693135e+308, Minimum=-1.797693135e+308, TreeAccess=False)
warehouse_2 = GetNumber(warehouse, AtLeast=1, AtMost=1, Maximum=1.797693135e+308, Minimum=-1.797693135e+308, TreeAccess=False)
senior_living_2 = GetNumber(senior_living, AtLeast=1, AtMost=1, Maximum=1.797693135e+308, Minimum=-1.797693135e+308, TreeAccess=False)
healthcare_2 = GetNumber(healthcare, AtLeast=1, AtMost=1, Maximum=1.797693135e+308, Minimum=-1.797693135e+308, TreeAccess=False)
education_2 = GetNumber(education, AtLeast=1, AtMost=1, Maximum=1.797693135e+308, Minimum=-1.797693135e+308, TreeAccess=False)
cost_apartments_2 = GetNumber(cost_apartments, AtLeast=1, AtMost=1, Maximum=1.797693135e+308, Minimum=-1.797693135e+308, TreeAccess=False)
cost_student_housing_2 = GetNumber(cost_student_housing, AtLeast=1, AtMost=1, Maximum=1.797693135e+308, Minimum=-1.797693135e+308, TreeAccess=False)
flex_2 = GetNumber(flex, AtLeast=1, AtMost=1, Maximum=1.797693135e+308, Minimum=-1.797693135e+308, TreeAccess=False)
sports_2 = GetNumber(sports, AtLeast=1, AtMost=1, Maximum=1.797693135e+308, Minimum=-1.797693135e+308, TreeAccess=False)
cost_single_family_2 = GetNumber(cost_single_family, AtLeast=1, AtMost=1, Maximum=1.797693135e+308, Minimum=-1.797693135e+308, TreeAccess=False)
cost_condominiums_2 = GetNumber(cost_condominiums, AtLeast=1, AtMost=1, Maximum=1.797693135e+308, Minimum=-1.797693135e+308, TreeAccess=False)
cost_senior_living_2 = GetNumber(cost_senior_living, AtLeast=1, AtMost=1, Maximum=1.797693135e+308, Minimum=-1.797693135e+308, TreeAccess=False)
storage_2 = GetNumber(storage, AtLeast=1, AtMost=1, Maximum=1.797693135e+308, Minimum=-1.797693135e+308, TreeAccess=False)
cost_co_living_2 = GetNumber(cost_co_living, AtLeast=1, AtMost=1, Maximum=1.797693135e+308, Minimum=-1.797693135e+308, TreeAccess=False)
sell_apartments_2 = GetNumber(sell_apartments, AtLeast=1, AtMost=1, Maximum=1.797693135e+308, Minimum=-1.797693135e+308, TreeAccess=False)
cost_office_2 = GetNumber(cost_office, AtLeast=1, AtMost=1, Maximum=1.797693135e+308, Minimum=-1.797693135e+308, TreeAccess=False)
sell_condominiums_2 = GetNumber(sell_condominiums, AtLeast=1, AtMost=1, Maximum=1.797693135e+308, Minimum=-1.797693135e+308, TreeAccess=False)
sell_single_family_2 = GetNumber(sell_single_family, AtLeast=1, AtMost=1, Maximum=1.797693135e+308, Minimum=-1.797693135e+308, TreeAccess=False)
data_center_2 = GetNumber(data_center, AtLeast=1, AtMost=1, Maximum=1.797693135e+308, Minimum=-1.797693135e+308, TreeAccess=False)
cost_mall_2 = GetNumber(cost_mall, AtLeast=1, AtMost=1, Maximum=1.797693135e+308, Minimum=-1.797693135e+308, TreeAccess=False)
sell_student_housing_2 = GetNumber(sell_student_housing, AtLeast=1, AtMost=1, Maximum=1.797693135e+308, Minimum=-1.797693135e+308, TreeAccess=False)
cost_retail_2 = GetNumber(cost_retail, AtLeast=1, AtMost=1, Maximum=1.797693135e+308, Minimum=-1.797693135e+308, TreeAccess=False)
cost_food_beverage_2 = GetNumber(cost_food_beverage, AtLeast=1, AtMost=1, Maximum=1.797693135e+308, Minimum=-1.797693135e+308, TreeAccess=False)
sell_senior_living_2 = GetNumber(sell_senior_living, AtLeast=1, AtMost=1, Maximum=1.797693135e+308, Minimum=-1.797693135e+308, TreeAccess=False)
cost_warehouse_2 = GetNumber(cost_warehouse, AtLeast=1, AtMost=1, Maximum=1.797693135e+308, Minimum=-1.797693135e+308, TreeAccess=False)
sell_co_living_2 = GetNumber(sell_co_living, AtLeast=1, AtMost=1, Maximum=1.797693135e+308, Minimum=-1.797693135e+308, TreeAccess=False)
cost_hotel_2 = GetNumber(cost_hotel, AtLeast=1, AtMost=1, Maximum=1.797693135e+308, Minimum=-1.797693135e+308, TreeAccess=False)
cost_manufacturing_2 = GetNumber(cost_manufacturing, AtLeast=1, AtMost=1, Maximum=1.797693135e+308, Minimum=-1.797693135e+308, TreeAccess=False)
cost_data_center_2 = GetNumber(cost_data_center, AtLeast=1, AtMost=1, Maximum=1.797693135e+308, Minimum=-1.797693135e+308, TreeAccess=False)
cost_storage_2 = GetNumber(cost_storage, AtLeast=1, AtMost=1, Maximum=1.797693135e+308, Minimum=-1.797693135e+308, TreeAccess=False)
sell_hotel_2 = GetNumber(sell_hotel, AtLeast=1, AtMost=1, Maximum=1.797693135e+308, Minimum=-1.797693135e+308, TreeAccess=False)
cost_flex_2 = GetNumber(cost_flex, AtLeast=1, AtMost=1, Maximum=1.797693135e+308, Minimum=-1.797693135e+308, TreeAccess=False)
cost_extended_stay_2 = GetNumber(cost_extended_stay, AtLeast=1, AtMost=1, Maximum=1.797693135e+308, Minimum=-1.797693135e+308, TreeAccess=False)
cost_resort_2 = GetNumber(cost_resort, AtLeast=1, AtMost=1, Maximum=1.797693135e+308, Minimum=-1.797693135e+308, TreeAccess=False)
sell_extended_stay_2 = GetNumber(sell_extended_stay, AtLeast=1, AtMost=1, Maximum=1.797693135e+308, Minimum=-1.797693135e+308, TreeAccess=False)
cost_conference_center_2 = GetNumber(cost_conference_center, AtLeast=1, AtMost=1, Maximum=1.797693135e+308, Minimum=-1.797693135e+308, TreeAccess=False)
cost_healthcare_2 = GetNumber(cost_healthcare, AtLeast=1, AtMost=1, Maximum=1.797693135e+308, Minimum=-1.797693135e+308, TreeAccess=False)
cost_parking_2 = GetNumber(cost_parking, AtLeast=1, AtMost=1, Maximum=1.797693135e+308, Minimum=-1.797693135e+308, TreeAccess=False)
sell_office_2 = GetNumber(sell_office, AtLeast=1, AtMost=1, Maximum=1.797693135e+308, Minimum=-1.797693135e+308, TreeAccess=False)
cost_transit_2 = GetNumber(cost_transit, AtLeast=1, AtMost=1, Maximum=1.797693135e+308, Minimum=-1.797693135e+308, TreeAccess=False)
sell_warehouse_2 = GetNumber(sell_warehouse, AtLeast=1, AtMost=1, Maximum=1.797693135e+308, Minimum=-1.797693135e+308, TreeAccess=False)
cost_education_2 = GetNumber(cost_education, AtLeast=1, AtMost=1, Maximum=1.797693135e+308, Minimum=-1.797693135e+308, TreeAccess=False)
sell_resort_2 = GetNumber(sell_resort, AtLeast=1, AtMost=1, Maximum=1.797693135e+308, Minimum=-1.797693135e+308, TreeAccess=False)
sell_mall_2 = GetNumber(sell_mall, AtLeast=1, AtMost=1, Maximum=1.797693135e+308, Minimum=-1.797693135e+308, TreeAccess=False)
sell_conference_center_2 = GetNumber(sell_conference_center, AtLeast=1, AtMost=1, Maximum=1.797693135e+308, Minimum=-1.797693135e+308, TreeAccess=False)
cost_entertainment_2 = GetNumber(cost_entertainment, AtLeast=1, AtMost=1, Maximum=1.797693135e+308, Minimum=-1.797693135e+308, TreeAccess=False)
sell_retail_2 = GetNumber(sell_retail, AtLeast=1, AtMost=1, Maximum=1.797693135e+308, Minimum=-1.797693135e+308, TreeAccess=False)
sell_food_beverage_2 = GetNumber(sell_food_beverage, AtLeast=1, AtMost=1, Maximum=1.797693135e+308, Minimum=-1.797693135e+308, TreeAccess=False)
sell_manufacturing_2 = GetNumber(sell_manufacturing, AtLeast=1, AtMost=1, Maximum=1.797693135e+308, Minimum=-1.797693135e+308, TreeAccess=False)
cost_sports_2 = GetNumber(cost_sports, AtLeast=1, AtMost=1, Maximum=1.797693135e+308, Minimum=-1.797693135e+308, TreeAccess=False)
sell_flex_2 = GetNumber(sell_flex, AtLeast=1, AtMost=1, Maximum=1.797693135e+308, Minimum=-1.797693135e+308, TreeAccess=False)
sell_storage_2 = GetNumber(sell_storage, AtLeast=1, AtMost=1, Maximum=1.797693135e+308, Minimum=-1.797693135e+308, TreeAccess=False)
sell_entertainment_2 = GetNumber(sell_entertainment, AtLeast=1, AtMost=1, Maximum=1.797693135e+308, Minimum=-1.797693135e+308, TreeAccess=False)
sell_data_center_2 = GetNumber(sell_data_center, AtLeast=1, AtMost=1, Maximum=1.797693135e+308, Minimum=-1.797693135e+308, TreeAccess=False)
sell_healthcare_2 = GetNumber(sell_healthcare, AtLeast=1, AtMost=1, Maximum=1.797693135e+308, Minimum=-1.797693135e+308, TreeAccess=False)
sell_education_2 = GetNumber(sell_education, AtLeast=1, AtMost=1, Maximum=1.797693135e+308, Minimum=-1.797693135e+308, TreeAccess=False)
sell_sports_2 = GetNumber(sell_sports, AtLeast=1, AtMost=1, Maximum=1.797693135e+308, Minimum=-1.797693135e+308, TreeAccess=False)
sell_parking_2 = GetNumber(sell_parking, AtLeast=1, AtMost=1, Maximum=1.797693135e+308, Minimum=-1.797693135e+308, TreeAccess=False)
sell_transit_2 = GetNumber(sell_transit, AtLeast=1, AtMost=1, Maximum=1.797693135e+308, Minimum=-1.797693135e+308, TreeAccess=False)
merge = Merge(Data1=parking_2, Data2=transit_2)  # -> simplify(TRANS_pct)
merge_2 = Merge(Data1=warehouse_2, Data2=manufacturing_2, Data3=flex_2, Data4=storage_2, Data5=data_center_2)  # -> simplify(IND_pct)
merge_3 = Merge(Data1=healthcare_2, Data2=education_2, Data3=entertainment_2, Data4=sports_2)  # -> simplify(SERV_pct)
merge_4 = Merge(Data1=hotel_2, Data2=extended_stay_2, Data3=resort_2, Data4=conference_center_2)  # -> simplify(HOSP_pct)
merge_5 = Merge(Data1=office_2, Data2=retail_2, Data3=mall_2, Data4=food_beverage_2)  # -> simplify(COM_pct)
merge_6 = Merge(
    Data1=apartments_2,
    Data2=condominiums_2,
    Data3=single_family_2,
    Data4=student_housing_2,
    Data5=senior_living_2,
    Data6=co_living_2)  # -> simplify(RES_pct)

# ---- group: Building Parameters
floorheight = Slider(3, range=0..10)
numfloors = Slider(31, range=0..100)

# ----
merge_7 = Merge(Data1=cost_office_2, Data2=cost_retail_2, Data3=cost_mall_2, Data4=cost_food_beverage_2)  # -> simplify(COM_cost)
merge_8 = Merge(
    Data1=cost_apartments_2,
    Data2=cost_condominiums_2,
    Data3=cost_single_family_2,
    Data4=cost_student_housing_2,
    Data5=cost_senior_living_2,
    Data6=cost_co_living_2)  # -> simplify(RES_cost)
merge_9 = Merge(Data1=cost_hotel_2, Data2=cost_extended_stay_2, Data3=cost_resort_2, Data4=cost_conference_center_2)  # -> simplify(HOSP_cost)
merge_10 = Merge(Data1=sell_office_2, Data2=sell_retail_2, Data3=sell_mall_2, Data4=sell_food_beverage_2)  # -> simplify(COM_value)
merge_11 = Merge(Data1=sell_hotel_2, Data2=sell_extended_stay_2, Data3=sell_resort_2, Data4=sell_conference_center_2)  # -> simplify(HOSP_value)
merge_12 = Merge(Data1=cost_parking_2, Data2=cost_transit_2)  # -> simplify(TRANS_cost)
merge_13 = Merge(
    Data1=sell_apartments_2,
    Data2=sell_condominiums_2,
    Data3=sell_single_family_2,
    Data4=sell_student_housing_2,
    Data5=sell_senior_living_2,
    Data6=sell_co_living_2)  # -> simplify(RES_value)
industrial_value = Merge(Data1=sell_warehouse_2, Data2=sell_manufacturing_2, Data3=sell_flex_2, Data4=sell_storage_2, Data5=sell_data_center_2)  # -> simplify(IND_value)
merge_14 = Merge(Data1=sell_parking_2, Data2=sell_transit_2)  # -> simplify(TRANS_value)
merge_15 = Merge(Data1=sell_healthcare_2, Data2=sell_education_2, Data3=sell_entertainment_2, Data4=sell_sports_2)  # -> simplify(SERV_value)
merge_16 = Merge(Data1=cost_warehouse_2, Data2=cost_manufacturing_2, Data3=cost_flex_2, Data4=cost_storage_2, Data5=cost_data_center_2)  # -> simplify(IND_cost)
merge_17 = Merge(Data1=cost_healthcare_2, Data2=cost_education_2, Data3=cost_entertainment_2, Data4=cost_sports_2)  # -> simplify(SERV_cost)
curve = Curve(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)
python_3_script = Python3Script(
    siteCurve=curve,
    floorHeight=floorheight,
    numFloors=numfloors,
    subdivide_by_floor=Toggle(True),
    RES_pct=flatten(merge_6),
    COM_pct=flatten(merge_5),
    HOSP_pct=flatten(merge_4),
    IND_pct=flatten(merge_2),
    SERV_pct=flatten(merge_3),
    TRANS_pct=flatten(merge),
    RES_cost=flatten(merge_8),
    COM_cost=flatten(merge_7),
    HOSP_cost=flatten(merge_9),
    IND_cost=flatten(merge_16),
    SERV_cost=flatten(merge_17),
    TRANS_cost=flatten(merge_12),
    RES_value=flatten(merge_13),
    COM_value=flatten(merge_10),
    HOSP_value=flatten(merge_11),
    IND_value=flatten(industrial_value),
    SERV_value=flatten(merge_15),
    TRANS_value=flatten(merge_14))  # -> out, a, b, c, d, e, f, g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; inputs subdivide_by_floor: Boolean
# ---------- python_3_script: Python ----------
import rhinoscriptsyntax as rs
import Rhino.Geometry as rg
import scriptcontext as sc
import Grasshopper as gh

"""
Inputs:
  siteCurve, floorHeight, numFloors
  RES_pct, COM_pct, HOSP_pct, IND_pct, SERV_pct, TRANS_pct
  RES_cost, COM_cost, HOSP_cost, IND_cost, SERV_cost, TRANS_cost
  RES_value, COM_value, HOSP_value, IND_value, SERV_value, TRANS_value
  subdivide_by_floor (bool)

Outputs:
  a,b,c,d,e,f: geometry for each category
  g: total construction cost (string)
  h: total market value (string)
  i: overall ROI (string)
  j: cost breakdown per category (string)
  k: market value breakdown per category (string)
  l: category-specific ROI (string)
  m: profit breakdown per category (string)
  n: revenue-to-cost ratio per category (string)
  o: cost efficiency (cost per unit area) per category (string)
  out: debug logs
"""

def debug_print(msg):
    print(msg)

def pick_first(x):
    if isinstance(x, (list, tuple)) and len(x) > 0:
        return x[0]
    return x

# Force each input to be a single item.
siteCurve = pick_first(siteCurve)
floorHeight = pick_first(floorHeight)
numFloors = pick_first(numFloors)
RES_pct  = pick_first(RES_pct)
COM_pct  = pick_first(COM_pct)
HOSP_pct = pick_first(HOSP_pct)
IND_pct  = pick_first(IND_pct)
SERV_pct = pick_first(SERV_pct)
TRANS_pct= pick_first(TRANS_pct)
RES_cost   = pick_first(RES_cost)
COM_cost   = pick_first(COM_cost)
HOSP_cost  = pick_first(HOSP_cost)
IND_cost   = pick_first(IND_cost)
SERV_cost  = pick_first(SERV_cost)
TRANS_cost = pick_first(TRANS_cost)
RES_value   = pick_first(RES_value)
COM_value   = pick_first(COM_value)
HOSP_value  = pick_first(HOSP_value)
IND_value   = pick_first(IND_value)
SERV_value  = pick_first(SERV_value)
TRANS_value = pick_first(TRANS_value)
subdivide_by_floor = pick_first(subdivide_by_floor)

# Initialize geometry outputs
a=b=c=d=e=f=None
# Initialize text outputs
g=h=i=j=k=l=m=n=o=""

# 1. Convert the footprint curve
crv = rs.coercecurve(siteCurve)
if not crv:
    debug_print("Invalid or null footprint curve.")
else:
    # Project to XY plane for consistent area calculation
    proj_crv = crv.Duplicate()
    proj_crv.Transform(rg.Transform.PlanarProjection(rg.Plane.WorldXY))
    area_props = rg.AreaMassProperties.Compute(proj_crv)
    total_area = area_props.Area if area_props else 0
    debug_print(f"Footprint area: {total_area:.2f}")

    # 2. Total building height
    totalHeight = floorHeight * numFloors
    debug_print(f"Total building height: {totalHeight:.2f}")

    # 3. Category data
    categories = [
        {"name": "Residential",    "pct": RES_pct,   "cost": RES_cost,   "value": RES_value},
        {"name": "Commercial",     "pct": COM_pct,   "cost": COM_cost,   "value": COM_value},
        {"name": "Hospitality",    "pct": HOSP_pct,  "cost": HOSP_cost,  "value": HOSP_value},
        {"name": "Industrial",     "pct": IND_pct,   "cost": IND_cost,   "value": IND_value},
        {"name": "Service",        "pct": SERV_pct,  "cost": SERV_cost,  "value": SERV_value},
        {"name": "Transportation", "pct": TRANS_pct, "cost": TRANS_cost, "value": TRANS_value}
    ]

    # 4. Financial calculations
    total_cost = 0.0
    total_revenue = 0.0
    building_area = total_area * numFloors

    cat_costs = []
    cat_values = []
    cat_rois = []
    cat_areas = []  # To store each category's building area

    for cat in categories:
        fraction = cat["pct"] / 100.0
        cat_area = building_area * fraction
        cat_areas.append(cat_area)
        c_cost = cat_area * cat["cost"]
        c_value = cat_area * cat["value"]
        c_profit = c_value - c_cost
        c_roi = (c_profit / c_cost) * 100 if c_cost != 0 else 0

        cat_costs.append(c_cost)
        cat_values.append(c_value)
        cat_rois.append(c_roi)

        total_cost += c_cost
        total_revenue += c_value

    net_profit = total_revenue - total_cost
    overall_roi_val = (net_profit / total_cost) * 100 if total_cost != 0 else 0

    # 5. Create geometry (vertical stacking)
    bbox = crv.GetBoundingBox(True)
    min_pt = bbox.Min
    max_pt = bbox.Max
    x_min, x_max = min_pt.X, max_pt.X
    y_min, y_max = min_pt.Y, max_pt.Y

    cat_geos = [None]*6
    if (x_max - x_min) < 1e-6 or (y_max - y_min) < 1e-6 or totalHeight < 1e-6:
        debug_print("ERROR: Footprint or building height too small.")
    else:
        runningZ = 0.0
        for idx, cat in enumerate(categories):
            fraction = cat["pct"] / 100.0
            cat_height = totalHeight * fraction
            if cat_height < 0.01:
                debug_print(f"{cat['name']} block is too thin; skipping geometry.")
                continue

            if not subdivide_by_floor:
                # Single block
                cat_box = rg.Box(
                    rg.Plane.WorldXY,
                    rg.Interval(x_min, x_max),
                    rg.Interval(y_min, y_max),
                    rg.Interval(runningZ, runningZ + cat_height)
                )
                if cat_box and cat_box.IsValid:
                    b_cat = cat_box.ToBrep()
                    if b_cat and b_cat.IsValid:
                        cat_geos[idx] = b_cat
                        debug_print(f"{cat['name']} block: Z=({runningZ:.2f} to {runningZ+cat_height:.2f})")
            else:
                # Subdivide into individual floors
                cat_floor_count = max(1, int(round(fraction * numFloors)))
                floor_height_for_cat = cat_height / cat_floor_count
                floors = []
                for fl in range(cat_floor_count):
                    z1 = runningZ + fl * floor_height_for_cat
                    z2 = z1 + floor_height_for_cat
                    floor_box = rg.Box(
                        rg.Plane.WorldXY,
                        rg.Interval(x_min, x_max),
                        rg.Interval(y_min, y_max),
                        rg.Interval(z1, z2)
                    )
                    if floor_box and floor_box.IsValid:
                        fb = floor_box.ToBrep()
                        if fb and fb.IsValid:
                            floors.append(fb)
                if floors:
                    cat_geos[idx] = floors
                    debug_print(f"{cat['name']} subdivided into {len(floors)} floors.")
            runningZ += cat_height

    # 6. Assign geometry outputs
    a = cat_geos[0]  # Residential
    b = cat_geos[1]  # Commercial
    c = cat_geos[2]  # Hospitality
    d = cat_geos[3]  # Industrial
    e = cat_geos[4]  # Service
    f = cat_geos[5]  # Transportation

    # 7. Prepare final text outputs for overall metrics
    g = f"Total Construction Cost: {total_cost:.2f}"
    h = f"Total Market Value: {total_revenue:.2f}"
    i = f"Overall ROI: {overall_roi_val:.2f}%"

    # 8. Prepare breakdown percentages for cost, market value, and ROI per category
    cost_breaks = []
    value_breaks = []
    roi_breaks = []
    for idx, cat in enumerate(categories):
        cost_pct = (cat_costs[idx] / total_cost * 100) if total_cost != 0 else 0
        val_pct = (cat_values[idx] / total_revenue * 100) if total_revenue != 0 else 0
        roi_val = cat_rois[idx]
        cost_breaks.append(f"{cat['name']}: {cost_pct:.2f}%")
        value_breaks.append(f"{cat['name']}: {val_pct:.2f}%")
        roi_breaks.append(f"{cat['name']}: {roi_val:.2f}%")
    j = "\n".join(cost_breaks)
    k = "\n".join(value_breaks)
    l = "\n".join(roi_breaks)

    # 9. Additional financial metrics:
    # Profit breakdown and contribution, Revenue-to-Cost ratio, and Cost Efficiency (cost per unit area)
    profit_breaks = []
    ratio_breaks = []
    efficiency_breaks = []
    for idx, cat in enumerate(categories):
        cat_profit = cat_values[idx] - cat_costs[idx]
        profit_pct = (cat_profit / net_profit * 100) if net_profit != 0 else 0
        rev_to_cost_ratio = (cat_values[idx] / cat_costs[idx]) if cat_costs[idx] != 0 else 0
        # Cost efficiency: cost per unit area (using cat_area from earlier, stored in cat_areas)
        cat_area = cat_areas[idx]
        cost_efficiency = (cat_costs[idx] / cat_area) if cat_area != 0 else 0
        
        profit_breaks.append(f"{cat['name']}: Profit = {cat_profit:.2f}, {profit_pct:.2f}% of total")
        ratio_breaks.append(f"{cat['name']}: Rev/Cost Ratio = {rev_to_cost_ratio:.2f}")
        efficiency_breaks.append(f"{cat['name']}: Cost per Unit Area = {cost_efficiency:.2f}")
    
    m = "\n".join(profit_breaks)
    n = "\n".join(ratio_breaks)
    o = "\n".join(efficiency_breaks)
# ---------- end python_3_script ----------
panel = Panel(python_3_script.out)

# ---- group: Output Geometry
transportation = ColourSwatch(SwatchColor=RGBA(255, 189, 135, 150))
residential = ColourSwatch(SwatchColor=RGBA(171, 135, 255, 150))
commercial = ColourSwatch(SwatchColor=RGBA(135, 159, 255, 150))
industrial = ColourSwatch(SwatchColor=RGBA(135, 255, 141, 150))
hospitality = ColourSwatch(SwatchColor=RGBA(135, 231, 255, 150))
service = ColourSwatch(SwatchColor=RGBA(255, 255, 135, 150))
geometry = Geometry(python_3_script.b)
geometry_2 = Geometry(python_3_script.a)
geometry_3 = Geometry(python_3_script.c)
geometry_4 = Geometry(python_3_script.e)
geometry_5 = Geometry(python_3_script.d)
geometry_6 = Geometry(python_3_script.f)
custom_preview = CustomPreview(Geometry=geometry, Material=commercial)
custom_preview_2 = CustomPreview(Geometry=geometry_2, Material=residential)
custom_preview_3 = CustomPreview(Geometry=geometry_3, Material=hospitality)
custom_preview_4 = CustomPreview(Geometry=geometry_5, Material=industrial)
custom_preview_5 = CustomPreview(Geometry=geometry_4, Material=service)
custom_preview_6 = CustomPreview(Geometry=geometry_6, Material=transportation)

# ----
revenue_to_cost_ratios = Panel(python_3_script.n)
overall_roi = Panel(python_3_script.i)
total_construction_cost = Panel(python_3_script.g)
cost_efficiency = Panel(python_3_script.o)
total_market_value = Panel(python_3_script.h)
detailed_construction_cost = Panel(python_3_script.j)
detailed_market_value = Panel(python_3_script.k)
profit_per_discipline = Panel(python_3_script.m)
detailed_roi_per_program = Panel(python_3_script.l)
context_bake = ContextBake(Residential=geometry_2)
context_bake_2 = ContextBake(Commercial=geometry)
context_bake_3 = ContextBake(Hospitality=geometry_3)
context_bake_4 = ContextBake(Content=geometry_4)
context_bake_5 = ContextBake(Transportation=geometry_6)
context_bake_6 = ContextBake(Industrial=geometry_5)
context_print = ContextPrint(DetailedROIPerProgram=detailed_roi_per_program)
context_print_2 = ContextPrint(DetailedMarketValue=detailed_market_value)
context_print_3 = ContextPrint(DetailedConstructionCost=detailed_construction_cost)
context_print_4 = ContextPrint(ProfitPerDiscipline=profit_per_discipline)
context_print_5 = ContextPrint(CostEfficiency=cost_efficiency)
context_print_6 = ContextPrint(TotalConstructionCost=total_construction_cost)
overall_roi_2 = ContextPrint(OverallROI=overall_roi)
context_print_7 = ContextPrint(RevenueToCostRatios=revenue_to_cost_ratios)
context_print_8 = ContextPrint(TotalMarketValue=total_market_value)
