# Grasshopper definition MINIMAL.gh (Grasshopper 1.0.8)
# plug-ins: RhinoCodePluginGH

# ---- group: CONSTRUCTION COST / ResidentialCost
cost_apartments = Slider(21539, range=0..1000000)

# ---- group: MARKET VALUE / ResidentialValue
sell_apartments = Slider(96667, range=0..1000000)

# ---- group: CONSTRUCTION COST / IndustrialCost
cost_warehouse = Slider(20880, range=0..1000000)

# ---- group: PROGRAM / Industrial
warehouse = Slider(10, range=0..100)

# ---- group: PROGRAM / Services
healthcare = Slider(10, range=0..100)

# ---- group: MARKET VALUE / IndustrialValue
sell_warehouse = Slider(73275, range=0..1000000)

# ---- group: PROGRAM / Transportation
parking = Slider(15, range=0..100)

# ---- group: CONSTRUCTION COST / CommercialCost
cost_office = Slider(16020, range=0..1000000)

# ---- group: CONSTRUCTION COST / ServiceCost
cost_healthcare = Slider(15660, range=0..1000000)

# ---- group: CONSTRUCTION COST / TransportationCost
cost_parking = Slider(8293, range=0..1000000)

# ---- group: MARKET VALUE / ServiceValue
sell_healthcare = Slider(86205, range=0..1000000)

# ---- group: CONSTRUCTION COST / HospitalityCost
cost_hotel = Slider(26770, range=0..1000000)

# ---- group: PROGRAM / Residential
apartments = Slider(40, range=0..100)

# ---- group: PROGRAM / Commercial
office = Slider(5, range=0..100)

# ---- group: PROGRAM / Hospitality
hotel = Slider(20, range=0..100)

# ---- group: MARKET VALUE / CommercialValue
sell_office = Slider(62858, range=0..1000000)

# ---- group: MARKET VALUE / HospitalityValue
sell_hotel = Slider(46371, range=0..1000000)

# ---- group: MARKET VALUE / TransportationValue
sell_parking = Slider(94287, range=0..1000000)

# ----
sell_healthcare_2 = GetNumber(sell_healthcare, AtLeast=1, AtMost=1, Maximum=1.797693135e+308, Minimum=-1.797693135e+308, TreeAccess=False)
sell_warehouse_2 = GetNumber(sell_warehouse, AtLeast=1, AtMost=1, Maximum=1.797693135e+308, Minimum=-1.797693135e+308, TreeAccess=False)
sell_parking_2 = GetNumber(sell_parking, AtLeast=1, AtMost=1, Maximum=1.797693135e+308, Minimum=-1.797693135e+308, TreeAccess=False)
sell_hotel_2 = GetNumber(sell_hotel, AtLeast=1, AtMost=1, Maximum=1.797693135e+308, Minimum=-1.797693135e+308, TreeAccess=False)
apartments_2 = GetNumber(apartments, AtLeast=1, AtMost=1, Maximum=1.797693135e+308, Minimum=-1.797693135e+308, TreeAccess=False)
office_2 = GetNumber(office, AtLeast=1, AtMost=1, Maximum=1.797693135e+308, Minimum=-1.797693135e+308, TreeAccess=False)
hotel_2 = GetNumber(hotel, AtLeast=1, AtMost=1, Maximum=1.797693135e+308, Minimum=-1.797693135e+308, TreeAccess=False)
warehouse_2 = GetNumber(warehouse, AtLeast=1, AtMost=1, Maximum=1.797693135e+308, Minimum=-1.797693135e+308, TreeAccess=False)
sell_apartments_2 = GetNumber(sell_apartments, AtLeast=1, AtMost=1, Maximum=1.797693135e+308, Minimum=-1.797693135e+308, TreeAccess=False)
sell_office_2 = GetNumber(sell_office, AtLeast=1, AtMost=1, Maximum=1.797693135e+308, Minimum=-1.797693135e+308, TreeAccess=False)
parking_2 = GetNumber(parking, AtLeast=1, AtMost=1, Maximum=1.797693135e+308, Minimum=-1.797693135e+308, TreeAccess=False)
healthcare_2 = GetNumber(healthcare, AtLeast=1, AtMost=1, Maximum=1.797693135e+308, Minimum=-1.797693135e+308, TreeAccess=False)
cost_hotel_2 = GetNumber(cost_hotel, AtLeast=1, AtMost=1, Maximum=1.797693135e+308, Minimum=-1.797693135e+308, TreeAccess=False)
cost_healthcare_2 = GetNumber(cost_healthcare, AtLeast=1, AtMost=1, Maximum=1.797693135e+308, Minimum=-1.797693135e+308, TreeAccess=False)
cost_office_2 = GetNumber(cost_office, AtLeast=1, AtMost=1, Maximum=1.797693135e+308, Minimum=-1.797693135e+308, TreeAccess=False)
cost_warehouse_2 = GetNumber(cost_warehouse, AtLeast=1, AtMost=1, Maximum=1.797693135e+308, Minimum=-1.797693135e+308, TreeAccess=False)

# ---- group: Building Parameters
floorheight = Slider(3, range=0..10)
numfloors = Slider(31, range=0..100)

# ----
cost_apartments_2 = GetNumber(cost_apartments, AtLeast=1, AtMost=1, Maximum=1.797693135e+308, Minimum=-1.797693135e+308, TreeAccess=False)
cost_parking_2 = GetNumber(cost_parking, AtLeast=1, AtMost=1, Maximum=1.797693135e+308, Minimum=-1.797693135e+308, TreeAccess=False)
curve = Curve(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)
python_3_script = Python3Script(
    siteCurve=curve,
    floorHeight=floorheight,
    numFloors=numfloors,
    subdivide_by_floor=Toggle(True),
    RES_pct=apartments_2,
    COM_pct=office_2,
    HOSP_pct=hotel_2,
    IND_pct=warehouse_2,
    SERV_pct=healthcare_2,
    TRANS_pct=parking_2,
    RES_cost=cost_apartments_2,
    COM_cost=cost_office_2,
    HOSP_cost=cost_hotel_2,
    IND_cost=cost_warehouse_2,
    SERV_cost=cost_healthcare_2,
    TRANS_cost=cost_parking_2,
    RES_value=sell_apartments_2,
    COM_value=sell_office_2,
    HOSP_value=sell_hotel_2,
    IND_value=sell_warehouse_2,
    SERV_value=sell_healthcare_2,
    TRANS_value=sell_parking_2)  # -> out, a, b, c, d, e, f, g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; inputs subdivide_by_floor: Boolean
# ---------- python_3_script: Python ----------
import rhinoscriptsyntax as rs
import Rhino.Geometry as rg
import scriptcontext as sc
import Grasshopper as gh

"""
Inputs:
  siteCurve, floorHeight, numFloors
  RES_pct, COM_pct, HOSP_pct, IND_pct, SERV_pct, TRANS_pct
  RES_cost, COM_cost, HOSP_cost, IND_cost, SERV_cost, TRANS_cost
  RES_value, COM_value, HOSP_value, IND_value, SERV_value, TRANS_value
  subdivide_by_floor (bool)

Outputs:
  a,b,c,d,e,f: geometry for each category
  g: total construction cost (string)
  h: total market value (string)
  i: overall ROI (string)
  j: cost breakdown per category (string)
  k: market value breakdown per category (string)
  l: category-specific ROI (string)
  m: profit breakdown per category (string)
  n: revenue-to-cost ratio per category (string)
  o: cost efficiency (cost per unit area) per category (string)
  out: debug logs
"""

def debug_print(msg):
    print(msg)

def pick_first(x):
    if isinstance(x, (list, tuple)) and len(x) > 0:
        return x[0]
    return x

# Force each input to be a single item.
siteCurve = pick_first(siteCurve)
floorHeight = pick_first(floorHeight)
numFloors = pick_first(numFloors)
RES_pct  = pick_first(RES_pct)
COM_pct  = pick_first(COM_pct)
HOSP_pct = pick_first(HOSP_pct)
IND_pct  = pick_first(IND_pct)
SERV_pct = pick_first(SERV_pct)
TRANS_pct= pick_first(TRANS_pct)
RES_cost   = pick_first(RES_cost)
COM_cost   = pick_first(COM_cost)
HOSP_cost  = pick_first(HOSP_cost)
IND_cost   = pick_first(IND_cost)
SERV_cost  = pick_first(SERV_cost)
TRANS_cost = pick_first(TRANS_cost)
RES_value   = pick_first(RES_value)
COM_value   = pick_first(COM_value)
HOSP_value  = pick_first(HOSP_value)
IND_value   = pick_first(IND_value)
SERV_value  = pick_first(SERV_value)
TRANS_value = pick_first(TRANS_value)
subdivide_by_floor = pick_first(subdivide_by_floor)

# Initialize geometry outputs
a=b=c=d=e=f=None
# Initialize text outputs
g=h=i=j=k=l=m=n=o=""

# 1. Convert the footprint curve
crv = rs.coercecurve(siteCurve)
if not crv:
    debug_print("Invalid or null footprint curve.")
else:
    # Project to XY plane for consistent area calculation
    proj_crv = crv.Duplicate()
    proj_crv.Transform(rg.Transform.PlanarProjection(rg.Plane.WorldXY))
    area_props = rg.AreaMassProperties.Compute(proj_crv)
    total_area = area_props.Area if area_props else 0
    debug_print(f"Footprint area: {total_area:.2f}")

    # 2. Total building height
    totalHeight = floorHeight * numFloors
    debug_print(f"Total building height: {totalHeight:.2f}")

    # 3. Category data
    categories = [
        {"name": "Residential",    "pct": RES_pct,   "cost": RES_cost,   "value": RES_value},
        {"name": "Commercial",     "pct": COM_pct,   "cost": COM_cost,   "value": COM_value},
        {"name": "Hospitality",    "pct": HOSP_pct,  "cost": HOSP_cost,  "value": HOSP_value},
        {"name": "Industrial",     "pct": IND_pct,   "cost": IND_cost,   "value": IND_value},
        {"name": "Service",        "pct": SERV_pct,  "cost": SERV_cost,  "value": SERV_value},
        {"name": "Transportation", "pct": TRANS_pct, "cost": TRANS_cost, "value": TRANS_value}
    ]

    # 4. Financial calculations
    total_cost = 0.0
    total_revenue = 0.0
    building_area = total_area * numFloors

    cat_costs = []
    cat_values = []
    cat_rois = []
    cat_areas = []  # To store each category's building area

    for cat in categories:
        fraction = cat["pct"] / 100.0
        cat_area = building_area * fraction
        cat_areas.append(cat_area)
        c_cost = cat_area * cat["cost"]
        c_value = cat_area * cat["value"]
        c_profit = c_value - c_cost
        c_roi = (c_profit / c_cost) * 100 if c_cost != 0 else 0

        cat_costs.append(c_cost)
        cat_values.append(c_value)
        cat_rois.append(c_roi)

        total_cost += c_cost
        total_revenue += c_value

    net_profit = total_revenue - total_cost
    overall_roi_val = (net_profit / total_cost) * 100 if total_cost != 0 else 0

    # 5. Create geometry (vertical stacking)
    bbox = crv.GetBoundingBox(True)
    min_pt = bbox.Min
    max_pt = bbox.Max
    x_min, x_max = min_pt.X, max_pt.X
    y_min, y_max = min_pt.Y, max_pt.Y

    cat_geos = [None]*6
    if (x_max - x_min) < 1e-6 or (y_max - y_min) < 1e-6 or totalHeight < 1e-6:
        debug_print("ERROR: Footprint or building height too small.")
    else:
        runningZ = 0.0
        for idx, cat in enumerate(categories):
            fraction = cat["pct"] / 100.0
            cat_height = totalHeight * fraction
            if cat_height < 0.01:
                debug_print(f"{cat['name']} block is too thin; skipping geometry.")
                continue

            if not subdivide_by_floor:
                # Single block
                cat_box = rg.Box(
                    rg.Plane.WorldXY,
                    rg.Interval(x_min, x_max),
                    rg.Interval(y_min, y_max),
                    rg.Interval(runningZ, runningZ + cat_height)
                )
                if cat_box and cat_box.IsValid:
                    b_cat = cat_box.ToBrep()
                    if b_cat and b_cat.IsValid:
                        cat_geos[idx] = b_cat
                        debug_print(f"{cat['name']} block: Z=({runningZ:.2f} to {runningZ+cat_height:.2f})")
            else:
                # Subdivide into individual floors
                cat_floor_count = max(1, int(round(fraction * numFloors)))
                floor_height_for_cat = cat_height / cat_floor_count
                floors = []
                for fl in range(cat_floor_count):
                    z1 = runningZ + fl * floor_height_for_cat
                    z2 = z1 + floor_height_for_cat
                    floor_box = rg.Box(
                        rg.Plane.WorldXY,
                        rg.Interval(x_min, x_max),
                        rg.Interval(y_min, y_max),
                        rg.Interval(z1, z2)
                    )
                    if floor_box and floor_box.IsValid:
                        fb = floor_box.ToBrep()
                        if fb and fb.IsValid:
                            floors.append(fb)
                if floors:
                    cat_geos[idx] = floors
                    debug_print(f"{cat['name']} subdivided into {len(floors)} floors.")
            runningZ += cat_height

    # 6. Assign geometry outputs
    a = cat_geos[0]  # Residential
    b = cat_geos[1]  # Commercial
    c = cat_geos[2]  # Hospitality
    d = cat_geos[3]  # Industrial
    e = cat_geos[4]  # Service
    f = cat_geos[5]  # Transportation

    # 7. Prepare final text outputs for overall metrics
    g = f"Total Construction Cost: {total_cost:.2f}"
    h = f"Total Market Value: {total_revenue:.2f}"
    i = f"Overall ROI: {overall_roi_val:.2f}%"

    # 8. Prepare breakdown percentages for cost, market value, and ROI per category
    cost_breaks = []
    value_breaks = []
    roi_breaks = []
    for idx, cat in enumerate(categories):
        cost_pct = (cat_costs[idx] / total_cost * 100) if total_cost != 0 else 0
        val_pct = (cat_values[idx] / total_revenue * 100) if total_revenue != 0 else 0
        roi_val = cat_rois[idx]
        cost_breaks.append(f"{cat['name']}: {cost_pct:.2f}%")
        value_breaks.append(f"{cat['name']}: {val_pct:.2f}%")
        roi_breaks.append(f"{cat['name']}: {roi_val:.2f}%")
    j = "\n".join(cost_breaks)
    k = "\n".join(value_breaks)
    l = "\n".join(roi_breaks)

    # 9. Additional financial metrics:
    # Profit breakdown and contribution, Revenue-to-Cost ratio, and Cost Efficiency (cost per unit area)
    profit_breaks = []
    ratio_breaks = []
    efficiency_breaks = []
    for idx, cat in enumerate(categories):
        cat_profit = cat_values[idx] - cat_costs[idx]
        profit_pct = (cat_profit / net_profit * 100) if net_profit != 0 else 0
        rev_to_cost_ratio = (cat_values[idx] / cat_costs[idx]) if cat_costs[idx] != 0 else 0
        # Cost efficiency: cost per unit area (using cat_area from earlier, stored in cat_areas)
        cat_area = cat_areas[idx]
        cost_efficiency = (cat_costs[idx] / cat_area) if cat_area != 0 else 0
        
        profit_breaks.append(f"{cat['name']}: Profit = {cat_profit:.2f}, {profit_pct:.2f}% of total")
        ratio_breaks.append(f"{cat['name']}: Rev/Cost Ratio = {rev_to_cost_ratio:.2f}")
        efficiency_breaks.append(f"{cat['name']}: Cost per Unit Area = {cost_efficiency:.2f}")
    
    m = "\n".join(profit_breaks)
    n = "\n".join(ratio_breaks)
    o = "\n".join(efficiency_breaks)
# ---------- end python_3_script ----------
panel = Panel(python_3_script.out)

# ---- group: Output Geometry
transportation = ColourSwatch(SwatchColor=RGBA(255, 189, 135, 150))
residential = ColourSwatch(SwatchColor=RGBA(171, 135, 255, 150))
commercial = ColourSwatch(SwatchColor=RGBA(135, 159, 255, 150))
industrial = ColourSwatch(SwatchColor=RGBA(135, 255, 141, 150))
hospitality = ColourSwatch(SwatchColor=RGBA(135, 231, 255, 150))
service = ColourSwatch(SwatchColor=RGBA(255, 255, 135, 150))
geometry = Geometry(python_3_script.b)
geometry_2 = Geometry(python_3_script.a)
geometry_3 = Geometry(python_3_script.c)
geometry_4 = Geometry(python_3_script.d)
geometry_5 = Geometry(python_3_script.e)
geometry_6 = Geometry(python_3_script.f)
custom_preview = CustomPreview(Geometry=geometry_2, Material=residential)
custom_preview_2 = CustomPreview(Geometry=geometry, Material=commercial)
custom_preview_3 = CustomPreview(Geometry=geometry_3, Material=hospitality)
custom_preview_4 = CustomPreview(Geometry=geometry_5, Material=service)
custom_preview_5 = CustomPreview(Geometry=geometry_6, Material=transportation)
custom_preview_6 = CustomPreview(Geometry=geometry_4, Material=industrial)

# ----
revenue_to_cost_ratios = Panel(python_3_script.n)
overall_roi = Panel(python_3_script.i)
total_construction_cost = Panel(python_3_script.g)
cost_efficiency = Panel(python_3_script.o)
total_market_value = Panel(python_3_script.h)
detailed_construction_cost = Panel(python_3_script.j)
detailed_market_value = Panel(python_3_script.k)
profit_per_discipline = Panel(python_3_script.m)
detailed_roi_per_program = Panel(python_3_script.l)
context_bake = ContextBake(Residential=python_3_script.a)
context_bake_2 = ContextBake(Commercial=python_3_script.b)
context_bake_3 = ContextBake(Hospitality=python_3_script.c)
context_print = ContextPrint(TotalConstructionCost=total_construction_cost)
context_bake_4 = ContextBake(Content=python_3_script.e)
context_bake_5 = ContextBake(Transportation=python_3_script.f)
total_market_value_2 = ContextPrint(TotalMarketValue=total_market_value)
context_print_2 = ContextPrint(OverallROI=overall_roi)
context_print_3 = ContextPrint(RevenueToCostRatios=revenue_to_cost_ratios)
context_print_4 = ContextPrint(DetailedConstructionCost=detailed_construction_cost)
context_print_5 = ContextPrint(ProfitPerDiscipline=profit_per_discipline)
context_print_6 = ContextPrint(DetailedMarketValue=detailed_market_value)
context_bake_6 = ContextBake(Industrial=python_3_script.d)
context_print_7 = ContextPrint(DetailedROIPerProgram=detailed_roi_per_program)
context_print_8 = ContextPrint(CostEfficiency=cost_efficiency)
