# Grasshopper definition MINIMAL_HOPS.gh (Grasshopper 1.0.8)
# plug-ins: Hops

# ---- group: CONSTRUCTION COST / ResidentialCost
cost_apartments = Slider(21539, range=0..1000000)

# ---- group: MARKET VALUE / ResidentialValue
sell_apartments = Slider(96667, range=0..1000000)

# ---- group: CONSTRUCTION COST / IndustrialCost
cost_warehouse = Slider(20880, range=0..1000000)

# ---- group: PROGRAM / Industrial
warehouse = Slider(10, range=0..100)

# ---- group: PROGRAM / Services
healthcare = Slider(10, range=0..100)

# ---- group: CONSTRUCTION COST / ServiceCost
cost_healthcare = Slider(15660, range=0..1000000)

# ---- group: MARKET VALUE / IndustrialValue
sell_warehouse = Slider(73275, range=0..1000000)

# ---- group: PROGRAM / Transportation
parking = Slider(15, range=0..100)

# ---- group: CONSTRUCTION COST / CommercialCost
cost_office = Slider(16020, range=0..1000000)

# ---- group: CONSTRUCTION COST / TransportationCost
cost_parking = Slider(8293, range=0..1000000)

# ---- group: MARKET VALUE / ServiceValue
sell_healthcare = Slider(86205, range=0..1000000)

# ---- group: CONSTRUCTION COST / HospitalityCost
cost_hotel = Slider(26770, range=0..1000000)

# ---- group: PROGRAM / Residential
apartments = Slider(40, range=0..100)

# ---- group: PROGRAM / Hospitality
hotel = Slider(20, range=0..100)

# ---- group: PROGRAM / Commercial
office = Slider(5, range=0..100)

# ---- group: MARKET VALUE / CommercialValue
sell_office = Slider(62858, range=0..1000000)

# ---- group: MARKET VALUE / HospitalityValue
sell_hotel = Slider(46371, range=0..1000000)

# ---- group: MARKET VALUE / TransportationValue
sell_parking = Slider(94287, range=0..1000000)

# ----
hops = Hops(
    Apartments=apartments,
    Office=office,
    Hotel=hotel,
    Warehouse=warehouse,
    Healthcare=healthcare,
    Parking=parking,
    Cost_Apartments=cost_apartments,
    Cost_Office=cost_office,
    Cost_Hotel=cost_hotel,
    Cost_Warehouse=cost_warehouse,
    Cost_Healthcare=cost_healthcare,
    Cost_Parking=cost_parking,
    Sell_Apartments=sell_apartments,
    Sell_Office=sell_office,
    Sell_Hotel=sell_hotel,
    Sell_Warehouse=sell_warehouse,
    Sell_Healthcare=sell_healthcare,
    Sell_Parking=sell_parking,
    CacheResultsInMemory=True,
    CacheSolveResults=True,
    RemoteDefinitionLocation="C:\Users\aponw\OneDrive\Escritorio\Session02\DataMgmt_Final\MINIMAL.gh",
    RemoteSolveVersion=(0, 1, 0),
    ShowInput_Enabled=False,
    ShowInput_Path=False,
    SynchronousSolve=True)  # -> Residential, Commercial, Hospitality, Industrial, Service, Transportation, TotalConstructionCost, TotalMarketValue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
panel = Panel(hops.TotalConstructionCost)
panel_2 = Panel(hops.TotalMarketValue)
panel_3 = Panel(hops.OverallROI)
panel_4 = Panel(hops.DetailedConstructionCost)
panel_5 = Panel(hops.DetailedMarketValue)
panel_6 = Panel(hops.DetailedROIPerProgram)
panel_7 = Panel(hops.ProfitPerDiscipline)

# ---- group: Output Geometry
transportation = ColourSwatch(SwatchColor=RGBA(255, 189, 135, 150))
residential = ColourSwatch(SwatchColor=RGBA(171, 135, 255, 150))
commercial = ColourSwatch(SwatchColor=RGBA(135, 159, 255, 150))
industrial = ColourSwatch(SwatchColor=RGBA(135, 255, 141, 150))
hospitality = ColourSwatch(SwatchColor=RGBA(135, 231, 255, 150))
service = ColourSwatch(SwatchColor=RGBA(255, 255, 135, 150))
geometry = Geometry(hops.Commercial)
geometry_2 = Geometry(hops.Residential)
geometry_3 = Geometry(hops.Hospitality)
geometry_4 = Geometry(hops.Industrial)
geometry_5 = Geometry(hops.Service)
geometry_6 = Geometry(hops.Transportation)
custom_preview = CustomPreview(Geometry=geometry_2, Material=residential)
custom_preview_2 = CustomPreview(Geometry=geometry, Material=commercial)
custom_preview_3 = CustomPreview(Geometry=geometry_3, Material=hospitality)
custom_preview_4 = CustomPreview(Geometry=geometry_5, Material=service)
custom_preview_5 = CustomPreview(Geometry=geometry_6, Material=transportation)
custom_preview_6 = CustomPreview(Geometry=geometry_4, Material=industrial)

# ----
panel_8 = Panel(hops.RevenueToCostRatios)
panel_9 = Panel(hops.CostEfficiency)
